# Grasshopper definition gh-setpoint.gh (Grasshopper 1.0.7)

# ----
# 1) change ip to Odroid's address
# Mavros topic to publish data to
panel = Panel("ws://143.215.102.166:9090")
reset_websocket_client = Button()
# 2) connect after rosbridge is launched
websocket_client_start = WebsocketClientStart(Address=panel, InitalMessage="Hello World", Reset=reset_websocket_client)

# ----
# 3) double click to activate timer
# timer will send data every 100ms
# this is how the message that we're sending to ROS looks like
timer = Timer(TimerInterval=200, Target=websocket_client_sender)  # disabled

number_slider = Slider(1, range=-10..10)

# ---- group: setpoint position
python = PythonScript(topic="/bebop/setpoints", x=Slider(-4.2, range=-10..10), y=Slider(3.3, range=-10..10), z=number_slider, qw=number_slider)  # -> R
# ---------- python: Python ----------
import json

data = {
"op":"publish",
"topic":topic,
"msg":{
    "pose":{
        "position":{"x":(x or 0), "y":(y or 0), "z":(z or 0)},
        "orientation":{"x":(qx or 0), "y":(qy or 0), "z":(qz or 0), "w":(qw or 0)},
}
}
}

R = json.dumps(data, sort_keys=True,indent=2, separators=(',', ': '))
# ---------- end python ----------

# ----
websocket_client_sender = WebsocketClientSender(WebsocketObjects=websocket_client_start, Message=python)

panel_2 = Panel(python)
